# Grasshopper definition websocket test.ghx (Grasshopper 1.0.8)

S = Script()  # -> out, a
# ---------- S: Python ----------
import json

# Install websocket-client in Rhino's Python environment first:
# pip install websocket-client

import websocket


URL = "ws://127.0.0.1:8765"


# -------------------------------------------------
# Example geometry
# -------------------------------------------------

# Timber outline
outline = [
    [100, 100],
    [900, 100],
    [900, 500],
    [100, 500]
]


# Example crack
cracks = [
    [
        [250, 200],
        [350, 240],
        [420, 220],
        [500, 280]
    ]
]


# Example knots
knots = [
    {
        "x": 600,
        "y": 250,
        "radius": 20
    },
    {
        "x": 750,
        "y": 350,
        "radius": 15
    }
]


# Example cutting line
cuts = [
    [
        [700, 100],
        [700, 500]
    ]
]


# -------------------------------------------------
# Build JSON
# -------------------------------------------------

data = {
    "timber_id": "T001",
    "outline": outline,
    "cracks": cracks,
    "knots": knots,
    "cuts": cuts
}


message = json.dumps(data)


# -------------------------------------------------
# Send to Viewer
# -------------------------------------------------

try:

    ws = websocket.create_connection(URL)

    ws.send(message)

    ws.close()

    Status = "Sent successfully"

except Exception as e:

    Status = "ERROR: " + str(e)
# ---------- end S ----------
